# Grasshopper definition gh_excel.gh (Grasshopper 1.0.7)
# plug-ins: TT Toolbox

# ---- group: THIRD PROBLEM
file_path_stock = FilePath("C:\grasshopper\tut\STOCK.xlsx")
file_path_order = FilePath("C:\grasshopper\tut\ORDER.xlsx")
read_excel_sheet = ReadExcelSheet(Run=Toggle(True), FilePath=file_path_stock, Worksheet="1", Listen=False)  # -> UserMessages, Columns, Rows
read_excel_sheet_2 = ReadExcelSheet(Run=Toggle(True), FilePath=file_path_order, Worksheet="1", Listen=False)  # -> UserMessages, graft(Columns), Rows
panel = Panel(read_excel_sheet_2.Columns)
panel_2 = Panel(read_excel_sheet.Columns)
member_index = MemberIndex(Set=read_excel_sheet.Columns, Member=read_excel_sheet_2.Columns)  # -> Index, Count
list_length = ListLength(List=member_index.Index)
panel_3 = Panel(list_length)
larger_than = LargerThan(FirstNumber=list_length, SecondNumber="0")  # -> LargerThan, OrEqualTo
panel_4 = Panel(larger_than.LargerThan)
concatenate = Concatenate(Fragment_A=read_excel_sheet_2.Columns, A=" -", Fragment_B=larger_than.LargerThan)
panel_5 = Panel(concatenate)
write_to_excel = WriteToExcel(
    Run=Toggle(True),
    ExcelWorksheet="RESULT2",
    WriteOptions="None",
    ColumnnsOrRows="TRUE",
    DataToWriteIntoColumns=concatenate)

# ---- group: FIRST PROBLEM
file_path = FilePath("C:\grasshopper\tut\test1.xlsx")
read_excel_sheet_3 = ReadExcelSheet(Run=Toggle(True), FilePath=file_path, Worksheet="1", Listen=False)  # -> UserMessages, Columns, Rows
create_set = CreateSet(List=read_excel_sheet_3.Columns)  # -> flatten(Set), Map
panel_6 = Panel(create_set.Set)
member_index_2 = MemberIndex(Set=read_excel_sheet_3.Columns, Member=flatten(create_set.Set))  # -> Index, Count
panel_7 = Panel(member_index_2.Count)
merge = Merge(Data1=create_set.Set, Data2=member_index_2.Count)
write_to_excel_2 = WriteToExcel(Run=Toggle(False), ExcelWorksheet="RESULT", WriteOptions="None", ColumnnsOrRows="FALSE", DataToWriteIntoColumns=merge)
panel_8 = Panel(merge)

# ---- group: SECOND PROBLEM
file_path_2 = FilePath("C:\grasshopper\tut\test1.xlsx")
read_excel_sheet_4 = ReadExcelSheet(Run=Toggle(False), FilePath=file_path_2, Worksheet="Sheet2", Listen=False)  # -> UserMessages, Columns, Rows

# ---- group: SECOND PROBLEM / ADDITIONAL BLOCKS
cull_index = CullIndex(List=read_excel_sheet_4.Rows, Indices="0", Wrap=True)
list_item = ListItem(List=cull_index, Index=0, Wrap=True)  # -> Item, Item1
concatenate_2 = Concatenate(A=list_item.Item, B=" , ", C=list_item.Item1)  # -> flatten(Result)
panel_9 = Panel(concatenate_2)

# ---- group: SECOND PROBLEM (continued)
create_set_2 = CreateSet(List=concatenate_2)  # -> graft(Set), Map
panel_10 = Panel(create_set_2.Set)
member_index_3 = MemberIndex(Set=concatenate_2, Member=flatten(create_set_2.Set))  # -> Index, graft(Count)
merge_2 = Merge(Data1=create_set_2.Set, Data2=member_index_3.Count)
panel_11 = Panel(member_index_3.Count)
write_to_excel_3 = WriteToExcel(Run=Toggle(False), ExcelWorksheet="RESULT2", WriteOptions="None", ColumnnsOrRows="TRUE", DataToWriteIntoColumns=merge_2)
panel_12 = Panel(merge_2)
